# Grasshopper definition Save_Load.gh (Grasshopper 1.0.7)
# plug-ins: jSwan

# ----
# Lines into json
line = Line(Line((0, 0, 0), (10, 0, 0)))
rejson = SerializeJson(Curves=line, IncludeNullAndEmptyProperties=False)
dejson = DeserializeJson(JSON=rejson, OutputsLocked=False)
panel = Panel(rejson)
dejson_2 = DeserializeJson(JSON=dejson, OutputsLocked=False)  # -> From, FromX, FromY, FromZ, To, ToX, ToY, ToZ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
panel_2 = Panel(dejson)
panel_3 = Panel(dejson_2.From)
panel_4 = Panel(dejson_2.To)
panel_5 = Panel(dejson_2.Direction)
panel_6 = Panel(dejson_2.FromX)
panel_7 = Panel(dejson_2.FromZ)
panel_8 = Panel(dejson_2.ToX)
panel_9 = Panel(dejson_2.ToZ)
panel_10 = Panel(dejson_2.Length)
panel_11 = Panel(dejson_2.FromY)
panel_12 = Panel(dejson_2.ToY)
panel_13 = Panel(dejson_2.IsValid)
panel_14 = Panel(dejson_2.UnitTangent)
panel_15 = Panel(dejson_2.BoundingBox)
python = GhPythonScript(x=panel_3)  # -> a
# ---------- python: Python ----------
__author__ = "SKIKK"
__version__ = "2022.12.07"

import rhinoscriptsyntax as rs
import re

a = re.findall(r'\d+\.\d*', x)
# ---------- end python ----------
# From json through regexp to Rhino
panel_16 = Panel(python)

crv = Curve(<curve referenced from the Rhino model>)
rejson_2 = SerializeJson(Curves=crv, IncludeNullAndEmptyProperties=False)
dejson_3 = DeserializeJson(JSON=rejson_2, OutputsLocked=False)
panel_17 = Panel(rejson_2)
panel_18 = Panel(dejson_3)
# Curves into json
dejson_4 = DeserializeJson(JSON=dejson_3, OutputsLocked=False)  # -> Version, Archive3dm, Opennurbs, Data
# Can't recreate
# Curves from json
crv_2 = Curve(panel_18)

# ----
# Point Coordinates
number_slider = Slider(0, range=0..10)
# jSwan
# Save and Load Point
pt = ConstructPoint(XCoordinate=Slider(0, range=0..10), YCoordinate=number_slider, ZCoordinate="0")

panel_19 = Panel("C:\University\3. Semester\Artificial Ossification\json\Test_Point.json")
pt_2 = Point(pt)
move_pt = GhPythonScript(Input_Pt=pt_2)  # -> New_Pt; inputs Input_Pt: Point3d
# ---------- move_pt: Python ----------
__author__ = "SKIKK"
__version__ = "2022.12.06"

import rhinoscriptsyntax as rs
import json
import Grasshopper as gh

Point = Input_Pt

New_Pt = Point
# ---------- end move_pt ----------
rejson_3 = SerializeJson(Points=pt_2, IncludeNullAndEmptyProperties=False)
save = Button()
load = BooleanToggle(False)
save_2 = Button()
save_3 = BooleanToggle(False)
save_4 = GhPythonScript(Input_Pt=move_pt, Save=[save_3, save_2])  # inputs Input_Pt: Point3d
# ---------- save_4: Python ----------
__author__ = "SKIKK"
__version__ = "2022.12.06"

import rhinoscriptsyntax as rs
import json
import Grasshopper as gh

Point = Input_Pt

if Save:
    jsonOut = open(r"C:\University\3. Semester\Artificial Ossification\json\Test_Point.json","w")
    json.dump(Point,jsonOut)
    jsonOut.close()
# ---------- end save_4 ----------
save_5 = GhPythonScript(json_input=rejson_3, Save=save, path=panel_19)
# ---------- save_5: Python ----------
__author__ = "SKIKK"
__version__ = "2022.12.06"

import rhinoscriptsyntax as rs
import json
import Grasshopper as gh

if Save:
    
    jsonOut = open(r"{}".format(path),"w")
    json.dump(json_input,jsonOut)
    jsonOut.close()
# ---------- end save_5 ----------
panel_20 = Panel(rejson_3)
load_2 = GhPythonScript(path=panel_19, Load=load)  # -> json_output
# ---------- load_2: Python ----------
__author__ = "SKIKK"
__version__ = "2022.12.06"

import rhinoscriptsyntax as rs
import json

if Load:
    
    jsonFile = open(r"{}".format(path))
    
    json_output = json.load(jsonFile)
    jsonFile.close()
# ---------- end load_2 ----------
python_2 = GhPythonScript(x=rejson_3)  # -> a
# ---------- python_2: Python ----------
__author__ = "SKIKK"
__version__ = "2022.12.06"

import rhinoscriptsyntax as rs
import json

a = x
# ---------- end python_2 ----------
python_3 = GhPythonScript(x=rejson_3)  # -> a
# ---------- python_3: Python ----------
__author__ = "SKIKK"
__version__ = "2022.12.06"

import rhinoscriptsyntax as rs
import json

a = x.d1[0]
# ---------- end python_3 ----------
dejson_5 = DeserializeJson(JSON=panel_20, OutputsLocked=False)
dejson_6 = DeserializeJson(JSON=load_2, OutputsLocked=False)
panel_21 = Panel(pt_2)
panel_22 = Panel(rejson_3)
panel_23 = Panel(dejson_5)
panel_24 = Panel(python_2)
panel_25 = Panel(python_3)
panel_26 = Panel(dejson_6)
panel_27 = Panel(load_2)
dejson_7 = DeserializeJson(JSON=panel_23, OutputsLocked=False)  # -> X, Y, Z
dejson_8 = DeserializeJson(JSON=panel_26, OutputsLocked=False)  # -> X, Y, Z
panel_28 = Panel(dejson_7.X)
panel_29 = Panel(dejson_7.Y)
panel_30 = Panel(dejson_7.Z)
panel_31 = Panel(dejson_8.X)
panel_32 = Panel(dejson_8.Y)
panel_33 = Panel(dejson_8.Z)
pt_3 = ConstructPoint(XCoordinate=panel_28, YCoordinate=panel_29, ZCoordinate=panel_30)
pt_4 = ConstructPoint(XCoordinate=panel_31, YCoordinate=panel_32, ZCoordinate=panel_33)

pt_5 = Point(pt)
pt_6 = Point(pt)
# Multiple Points in json
pdecon = Deconstruct(Point=pt_5)  # -> XComponent, YComponent, ZComponent
pdecon_2 = Deconstruct(Point=pt_6)  # -> XComponent, YComponent, ZComponent
dejson_9 = DeserializeJson(JSON=pt_6, OutputsLocked=False)
rejson_4 = SerializeJson(Point=pt_6, IncludeNullAndEmptyProperties=False)
rejson_5 = SerializeJson(X=pdecon.XComponent, Y=pdecon.YComponent, Z=pdecon.ZComponent, IncludeNullAndEmptyProperties=False)
rejson_6 = SerializeJson(X=pdecon_2.XComponent, Y=pdecon_2.YComponent, Z=pdecon_2.ZComponent, IncludeNullAndEmptyProperties=False)
dejson_10 = DeserializeJson(JSON=rejson_4, OutputsLocked=False)
rejson_7 = SerializeJson(Points=[pt_5, pt_6], Coordinates=[rejson_5, rejson_6], IncludeNullAndEmptyProperties=False)
dejson_11 = DeserializeJson(JSON=dejson_10, OutputsLocked=False)  # -> X, Y, Z
panel_34 = Panel(rejson_7)

# ----
# Save & Load Values
panel_35 = Panel("C:\University\3. Semester\Artificial Ossification\json\")
# Save & Load Geometry
panel_36 = Panel("C:\University\3. Semester\Artificial Ossification\json\")
panel_37 = Panel("C:\University\3. Semester\Artificial Ossification\json\")
panel_38 = Panel("PickleTestData_Geometry")
# Save & Load Geometry
# inside of Classes
panel_39 = Panel("PickleTestData_Geometry")
# Load from File
toggle = BooleanToggle(True)
osteoblasts = Point([<point referenced from the Rhino model> x4])
osteoblasts_2 = Point([<point referenced from the Rhino model> x4])
osteoclasts = Point([<point referenced from the Rhino model> x5])
osteoclasts_2 = Point([<point referenced from the Rhino model> x5])
curves = Curve([<curve referenced from the Rhino model> x2])
curves_2 = Curve([<curve referenced from the Rhino model> x2])
python_4 = GhPythonScript(Load=toggle, path=panel_37, file_name=panel_38)  # -> out, loaded
# ---------- python_4: Python ----------
__author__ = "SKIKK"
__version__ = "2023.01.07"

import rhinoscriptsyntax as rs
import pickle

if Load:
    infile = open(r"{}{}.json".format(path,file_name),'rb')
    loaded = pickle.load(infile)
# ---------- end python_4 ----------
python_5 = GhPythonScript(
    osteoblasts=osteoblasts,
    osteoclasts=osteoclasts,
    geometry=curves,
    Save=Button(),
    Load=Toggle(False),
    path=panel_36,
    file_name=panel_39)  # -> input, loaded, p1, p2, g1; inputs osteoblasts: list of Point3d, osteoclasts: list of Point3d, geometry: list of Curve
# ---------- python_5: Python ----------
__author__ = "SKIKK"
__version__ = "2023.01.07"

import rhinoscriptsyntax as rs
import pickle

b = osteoblasts
c = osteoclasts
g = geometry
input = [b,c,g]

s = pickle.dumps(input)

l = pickle.loads(s)

if Save:
    outfile = open(r"{}{}.json".format(path,file_name),'wb')
    pickle.dump(input, outfile)
    outfile.close()

if Load:
    infile = open(r"{}{}.json".format(path,file_name),'rb')
    loaded = pickle.load(infile)
    
    p1 = loaded[0]
    p2 = loaded[1]
    g1 = loaded[2]
# ---------- end python_5 ----------
python_6 = GhPythonScript(
    osteoblasts=osteoblasts_2,
    osteoclasts=osteoclasts_2,
    geometry=curves_2,
    Save=Button(),
    Load=Toggle(False),
    path=panel_37,
    file_name=panel_38)  # -> input, loaded, p1, p2, g1; inputs osteoblasts: list of Point3d, osteoclasts: list of Point3d, geometry: list of Curve
# ---------- python_6: Python ----------
__author__ = "SKIKK"
__version__ = "2023.01.07"

import rhinoscriptsyntax as rs
import pickle

class TestClass():
    def __init__(self, b = osteoblasts, c = osteoclasts, g = geometry):
        self.b = b
        self.c = c
        self.g = g

input = TestClass()
print(vars(input))

#s = pickle.dumps(input)

#l = pickle.loads(s)

if Save:
    outfile = open(r"{}{}.json".format(path,file_name),'wb')
    pickle.dump(input, outfile)
    outfile.close()

if Load:
    infile = open(r"{}{}.json".format(path,file_name),'rb')
    loaded = pickle.load(infile)
    
    #p1 = loaded.b
    #p2 = loaded.c
    #g1 = loaded.g
# ---------- end python_6 ----------
# Pickle
python_7 = GhPythonScript(
    x=Slider(8, range=0..10),
    y=Slider(6, range=0..10),
    z=Slider(2, range=0..10),
    Save=Button(),
    Load=Toggle(False),
    path=panel_35,
    file_name="PickleTestData")  # -> input, loaded; inputs x: Int32, y: Int32, z: Int32
# ---------- python_7: Python ----------
__author__ = "SKIKK"
__version__ = "2023.01.06"

import rhinoscriptsyntax as rs
import pickle

d = [x, y, z]
print(d)
input = d

s = pickle.dumps(d)

l = pickle.loads(s)

if Save:
    outfile = open(r"{}{}.json".format(path,file_name),'wb')
    pickle.dump(d, outfile)
    outfile.close()

if Load:
    infile = open(r"{}{}.json".format(path,file_name),'rb')
    loaded = pickle.load(infile)

print(loaded)
# ---------- end python_7 ----------
panel_40 = Panel(python_4.loaded)
panel_41 = Panel(python_7.input)
panel_42 = Panel(python_7.loaded)
pt_7 = Point(python_5.p1)
pt_8 = Point(python_5.p2)
crv_3 = Curve(python_5.g1)
pt_9 = Point(python_6.p1)
pt_10 = Point(python_6.p2)
crv_4 = Curve(python_6.g1)
panel_43 = Panel(python_5.input)
panel_44 = Panel(python_5.loaded)
panel_45 = Panel(python_6.input)
panel_46 = Panel(python_6.loaded)

# ----
# y - Coordinate
panel_47 = Panel("""20
10
8
19""")
# z - Coordinate
panel_48 = Panel("""18
2
32
-10""")
# x - Coordinate
panel_49 = Panel("""15
0
-13
20""")
# Point Number - n
panel_50 = Panel("""0
1
2
3""")
python_8 = GhPythonScript(x="5", y="10", z="0", n="1")  # -> out, point
# ---------- python_8: Python ----------
point = [n,x,y,z]
# ---------- end python_8 ----------
python_9 = GhPythonScript(x=panel_49, y=panel_47, z=panel_48, n=panel_50)  # -> out, point; same code as python_8
# Point Array - n, x, y, z
python_10 = GhPythonScript(x=panel_49, y=panel_47, z=panel_48, n=panel_50)  # -> out, point
# ---------- python_10: Python ----------
point = [n, x, y, z]
# ---------- end python_10 ----------
python_11 = GhPythonScript()  # -> test123, test_array
# ---------- python_11: Python ----------
test_array = ["Karl", "Klaus", "Dieter", ["Thorsten", "Jamal", "Emilia"]]
output = test_array
test123 = 1
# ---------- end python_11 ----------
panel_51 = Panel(python_11.test123)
panel_52 = Panel(python_11.test_array)
panel_53 = Panel(python_8.point)
panel_54 = Panel(python_9.point)
python_12 = GhPythonScript(test_array=python_11.test_array)  # -> out, a, b, c
# ---------- python_12: Python ----------
a = test_array[0] # gibt den ersten Buchstaben aus
b = test_array[1]
c = test_array
# ---------- end python_12 ----------
point_number = Slider(2, range=0..3)
panel_55 = Panel(python_12.a)
panel_56 = Panel(python_12.b)
panel_57 = Panel(python_12.c)
list = ValueList({"n": 0, "x": 1, "y": 2, "z": 3}, selected="n")
python_13 = GhPythonScript(point=python_9.point, n=Slider(0, range=0..3))  # -> out, a, b; inputs n: Int32
# ---------- python_13: Python ----------
a = point[n]
b = point
# ---------- end python_13 ----------
python_14 = GhPythonScript(point=python_10.point, n1=list, n2=point_number)  # -> out, a, b; inputs point: tree of Int32, n1: Int32, n2: Int32
# ---------- python_14: Python ----------
import ghpythonlib.treehelpers as th

outputList1 = []
outputList2 = []
#pyList = [list(i) for i in point.Branches]
pyList = th.tree_to_list(point)

print point.Branch(0)
print len(pyList)
print range(len(pyList))

for j in range(len(pyList)):
    p = pyList[j][n1]
    outputList1.append(p)

for k in range(len(pyList[n2])):
    q = pyList[n2][k]
    outputList2.append(q)

a = outputList1
#b = point.Branch(0)
b = outputList2
# ---------- end python_14 ----------
python_15 = GhPythonScript(c=panel_57)  # -> out, test_array
# ---------- python_15: Python ----------
test_array = c
# ---------- end python_15 ----------
panel_58 = Panel(python_15.test_array)
panel_59 = Panel(python_14.a)
panel_60 = Panel(python_14.b)
panel_61 = Panel(python_13.a)
panel_62 = Panel(python_13.b)
panel_63 = Panel(python_10.point)

# ----
# Python Arrays
# Python - Grasshopper
# Array Interaction
panel_64 = Panel("Valentin")
python_16 = GhPythonScript(name=panel_64)  # -> test_array, name_3
# ---------- python_16: Python ----------
__author__ = "SKIKK"
__version__ = "2022.12.09"

import rhinoscriptsyntax as rs

test_array = ["Hans", name, "Klaus", "Murat"]
name_3 = test_array[2]
# ---------- end python_16 ----------
panel_65 = Panel(python_16.name_3)
panel_66 = Panel(python_16.test_array)

# ----
# Load and Save Path
panel_67 = Panel("C:\University\3. Semester\Artificial Ossification\json\")
# Working Load and Save Python Script
pop3d = Populate3D(
    Region={Plane=PlaneXY(0, 0, 0), X=Domain(0, 10), Y=Domain(0, 10), Z=Domain(0, 2)},
    Count=Slider(10, range=0..20),
    Seed=Slider(0, range=0..20))
pop3d_2 = Populate3D(
    Region={Plane=PlaneXY(0, 0, 0), X=Domain(0, 10), Y=Domain(0, 10), Z=Domain(0, 2)},
    Count=Slider(10, range=0..20),
    Seed=Slider(1, range=0..20))
osteoblasts_3 = Point(pop3d)
osteoclasts_3 = Point(pop3d_2)
# Input Objects
osteoblasts_4 = Point([<point referenced from the Rhino model> x4])
osteoclasts_4 = Point([<point referenced from the Rhino model> x5])
curves_3 = Curve([<curve referenced from the Rhino model> x2])
load_3 = BooleanToggle(False)
save_6 = Button()
panel_68 = Panel(osteoblasts_4)
save_load = GhPythonScript(
    osteoblasts=osteoblasts_4,
    osteoclasts=osteoclasts_4,
    geometry=curves_3,
    Save=save_6,
    Load=load_3,
    path=panel_67,
    file_name="Osteoblasts_Osteoclasts")  # -> out, test, coordinates, out_osteoblasts, out_osteoclasts, out_geometry; inputs osteoblasts: list of Point3d, osteoclasts: list of Point3d, geometry: list of Curve
# ---------- save_load: Python ----------
import rhinoscriptsyntax as rs
import ghpythonlib.treehelpers as gt
import json


# List Osteoblast Coordinates
px = []
py = []
pz = []

for i in osteoblasts:
    px.append(i.X)
    py.append(i.Y)
    pz.append(i.Z)

l_osteoblasts = []
for j in range(len(osteoblasts)):
    l_osteoblasts.append([px[j], py[j], pz[j]])



# List Osteoclast Coordinates
px = []
py = []
pz = []

for i in osteoclasts:
    px.append(i.X)
    py.append(i.Y)
    pz.append(i.Z)

l_osteoclasts = []
for j in range(len(osteoclasts)):
    l_osteoclasts.append([px[j], py[j], pz[j]])



# List Lines
sp = []
ep = []
l_geometry = []

for m in range(len(geometry)):
    sp.append(rs.CurveStartPoint(geometry[m]))
    ep.append(rs.CurveEndPoint(geometry[m]))
    l_geometry.append([[sp[m].X, sp[m].Y, sp[m].Z], [ep[m].X, ep[m].Y, ep[m].Z]])
print(sp[0].X)

# Save Data
json_content_save = [l_osteoblasts, l_osteoclasts, l_geometry]

if Save:
    
    jsonOut = open(r"{}{}.json".format(path,file_name),"w")
    json.dump(json_content_save,jsonOut)
    jsonOut.close()



# Load Data
json_content_load = []

if Load:
    jsonFile = open(r"{}{}.json".format(path,file_name))
    pyList = json.load(jsonFile)
    jsonFile.close()
    json_content_load = gt.list_to_tree(pyList)
    
    coordinates = json_content_load
    
    # Output Points
    c_points = gt.tree_to_list(json_content_load)
    c_blasts = c_points[0]
    c_clasts = c_points[1]
    
    out_osteoblasts = []
    for k in range(len(c_blasts)):
        points = rs.AddPoint(c_blasts[k])
        out_osteoblasts.append(points)
    
    out_osteoclasts = []
    for l in range(len(c_clasts)):
        points = rs.AddPoint(c_clasts[l])
        out_osteoclasts.append(points)
    
    test = gt.list_to_tree([out_osteoblasts, out_osteoclasts])
    
    # Output Lines
    c_lines = c_points[2]
    
    out_geometry = []
    for n in range(len(c_lines)):
        out_geometry.append(rs.AddLine(c_lines[n][0], c_lines[n][1]))
# ---------- end save_load ----------
pt_11 = Point(save_load.out_osteoblasts)
pt_12 = Point(save_load.out_osteoclasts)
# Output Objects
line_2 = Line(save_load.out_geometry)
simplify = SimplifyTree(Tree=save_load.coordinates, Front=False)
panel_69 = Panel(simplify)
panel_70 = Panel(save_load.test)

python_17 = GhPythonScript(
    Save=Button(),
    Load=Toggle(False),
    path="C:\University\3. Semester\Artificial Ossification\json\",
    file_name="PickleTestValues")  # -> input, loaded, p1, p2, g1; inputs osteoblasts: list of Point3d, osteoclasts: list of Point3d, geometry: list of Curve
# ---------- python_17: Python ----------
__author__ = "SKIKK"
__version__ = "2023.01.07"

import rhinoscriptsyntax as rs
import pickle

class Foo():
    def __init__(self, x, y):
        self.x = x
        self.y = y

f = Foo(10, [100, 200, 300])
print(vars(f))

if Save:
    outfile = open(r"{}{}.pkl".format(path,file_name),'wb')
    pickle.dump(f, outfile)
    outfile.close()

if Load:
    infile = open(r"{}{}.pkl".format(path,file_name),'rb')
    loaded = pickle.load(infile)
# ---------- end python_17 ----------

# ----
# Save and Load Python Array
panel_71 = Panel("C:\University\3. Semester\Artificial Ossification\json\")
load_4 = BooleanToggle(False)
load_5 = Button()
save_7 = Button()
save_8 = GhPythonScript(point=python_10.point, Save=save_7, path=panel_71, file_name="Test_Point_02")  # inputs point: tree
# ---------- save_8: Python ----------
import json

# Json Content
json_content = [list(i) for i in point.Branches]
print json_content

# Save as .json File
if Save:
    
    jsonOut = open(r"{}{}.json".format(path,file_name),"w")
    json.dump(json_content,jsonOut)
    jsonOut.close()
# ---------- end save_8 ----------
load_6 = GhPythonScript(path=panel_71, file_name="Test_Point_02", Load=load_4)  # -> json_content
# ---------- load_6: Python ----------
import json
import ghpythonlib.treehelpers as gt

if Load:
    jsonFile = open(r"{}{}.json".format(path,file_name))
    pyList = json.load(jsonFile)
    jsonFile.close()
    json_content = gt.list_to_tree(pyList)
# ---------- end load_6 ----------
panel_72 = Panel(load_6)

panel_73 = Panel(python_17.loaded)
